# Dynamo custom node Analysis Period.dyf (Dynamo 1.2.0.2690)
# category: Ladybug.01 :: Analyze Weather Data
# Analysis Period. -

input_python_script = CodeBlock { "Ladybug"; "analysisperiod_node.py"; }
import_and_prepare_py_code = Python(IN[0]=input_python_script.out0, IN[1]=input_python_script.out1)
# ---------- import_and_prepare_py_code.python (88 lines) ----------
        
"""Find packages from Dynamo folder and prepare the code."""
import clr
from System import AppDomain, Environment, IO

def tryGetPluginPath(plugin):
    """Try to get path to plugin folder."""
    clr.AddReference('ProtoGeometry')
    _loc = tuple(a.Location
                 for a in AppDomain.CurrentDomain.GetAssemblies()
                 if 'ProtoGeometry' in a.FullName)

    try:
        _ver = float(_loc[0].split('\\')[-2])
    except:
        _ver = float(_loc[0].split('\\')[-2].split(' ')[-1])

    assert _ver >= 1.2, 'You need Dynamo 1.2 or higher to use this plugin!'

    _appdata = Environment.GetFolderPath(Environment.SpecialFolder.ApplicationData)
    _dynamoPath = '%s\\%.1f' % (('\\').join(_loc[0].split('\\')[-4:-2]), float(_loc[0].split('\\')[-2]))
    # if the assembly is cached put Revit folder first, and then try to load it from core
    _dynamoPaths = (_dynamoPath.replace('Dynamo Core', 'Dynamo Revit'),
                    _dynamoPath.replace('Dynamo Revit', 'Dynamo Core'))
    _settingsFilename = 'DynamoSettings.xml'

    pkf = []
    for path in _dynamoPaths:
        settingsFile = IO.Path.Combine(_appdata, path, _settingsFilename)
        if IO.File.Exists(settingsFile):
            with open(settingsFile, 'rb') as outf:
                for line in outf:
                    if line.strip().startswith('<CustomPackageFolders>'):
                        for l in outf:
                            if l.strip().startswith('</CustomPackageFolders>'):
                                break
                            else:
                                pkf.append(l.replace('</string>', '').replace('<string>', '').strip())

    for p in pkf:
        pp = IO.Path.Combine(p, 'packages', plugin, 'extra')
        # In case of custom folders user may put honeybee under the root folder
        ppp = IO.Path.Combine(p, plugin, 'extra')
        if IO.Directory.Exists(pp):
            return pp
        elif IO.Directory.Exists(ppp):
            return ppp


try:
    plugin, filename = IN

    p = tryGetPluginPath(plugin)

    if not p:
        raise ImportError('{} is not installed! Install it from package manager.'.format(plugin))

	# import the file and wrap it into sys.append
    f = IO.Path.Combine(p, 'nodesrc', filename)
    with open(f, 'rb') as inf:
        source = '    '.join(inf.readlines())

    header = 'try:\n    import sys\n' + \
        '    sys.path.append(r\'{}\')\n\n'.format(p) + \
        '    sys.path.append(r\'C:\Program Files (x86)\IronPython 2.7\Lib\')\n\n' + \
        '    '

    footer = '\nexcept Exception, e:\n' + \
        '    import traceback\n' + \
        '    OUT = "ERROR:\\n\\t{}".format(str(e)) + \\\n' + \
        '    "\\n\\nIf you think this is a bug submit an issue on github.\\n" + \\\n' + \
        '    "https://github.com/ladybug-tools/ladybug-dynamo/issues\\n" +  \\\n' + \
        '    "and include below error message:\\n\\n" + \\\n' + \
        '    "{}".format(traceback.format_exc())\n'

    OUT = header + source + footer

except Exception, e:
    import sys
    sys.path.append(r'C:\Program Files (x86)\IronPython 2.7\Lib')
    import traceback
    OUT = "ERROR:\n\t{}".format(str(e)) + \
        "\n\nIf you think this is a bug submit an issue on github.\n" + \
        "https://github.com/ladybug-tools/ladybug-dynamo/issues\n" +  \
        "and include below error message:\n\n" + \
        "{}".format(traceback.format_exc())

      
# ----------------------------------------
startMonth = Input(_startMonth_: int = 1)  # Start month (1-12).
startDay = Input(_startDay_: int = 1)  # Start day (1-31).
startHour = Input(_startHour_: int = 0)  # Start hour (0-23).
endMonth = Input(_endMonth_: int = null)  # End month (1-12).
endDay = Input(_endDay_: int = null)  # End day (1-31).
endHour = Input(_endHour_: int = null)  # End hour (0-23).
timestep = Input(_timestep_: int = null)  # An integer number from 1, 2, 3, 4, 5, 6, 10, 12, 15, 20, 30, 60
core = PythonStringNode(script=import_and_prepare_py_code, IN[0]=startMonth, IN[1]=startDay, IN[2]=startHour, IN[3]=endMonth, IN[4]=endDay, IN[5]=endHour, IN[6]=timestep)
decompose_outputs = CodeBlock(out=core) { out[0]; out[1]; out[2]; }
analysisPeriod = Output(decompose_outputs.out0)  # Analysis period.
hoys = Output(decompose_outputs.out1)  # List of dates in this analysis period.
dates = Output(decompose_outputs.out2)  # List of hours of the year in this analysis period.
error_report = Python(IN[0]=import_and_prepare_py_code, IN[1]=core)
# ---------- error_report.python (17 lines) ----------
        
"""Report errors"""
importErr, runErr = IN
errors = []

if importErr and str(importErr).startswith("ERROR:"):
    errors.append(importErr)

if runErr and str(runErr).startswith("ERROR:"):
    errors.append(runErr)

if len(errors)==0:
    OUT = "All good! Vvizzzz."
else:
    OUT = "\n".join(errors)

      
# ----------------------------------------
ERRReport = Output(error_report)  # Report
