# Dynamo custom node Import EPW.dyf (Dynamo 1.2.0.2690)
# category: Ladybug.00 :: Ladybug
# Import epw. -

input_python_script = CodeBlock { "Ladybug"; "importepw_node.py"; }
import_and_prepare_py_code = Python(IN[0]=input_python_script.out0, IN[1]=input_python_script.out1)
# ---------- import_and_prepare_py_code.python (88 lines) ----------
        
"""Find packages from Dynamo folder and prepare the code."""
import clr
from System import AppDomain, Environment, IO

def tryGetPluginPath(plugin):
    """Try to get path to plugin folder."""
    clr.AddReference('ProtoGeometry')
    _loc = tuple(a.Location
                 for a in AppDomain.CurrentDomain.GetAssemblies()
                 if 'ProtoGeometry' in a.FullName)

    try:
        _ver = float(_loc[0].split('\\')[-2])
    except:
        _ver = float(_loc[0].split('\\')[-2].split(' ')[-1])

    assert _ver >= 1.2, 'You need Dynamo 1.2 or higher to use this plugin!'

    _appdata = Environment.GetFolderPath(Environment.SpecialFolder.ApplicationData)
    _dynamoPath = ('\\').join(_loc[0].split('\\')[-4:-1])
    # if the assembly is cached put Revit folder first, and then try to load it from core
    _dynamoPaths = (_dynamoPath.replace('Dynamo Core', 'Dynamo Revit'),
                    _dynamoPath.replace('Dynamo Revit', 'Dynamo Core'))
    _settingsFilename = 'DynamoSettings.xml'

    pkf = []
    for path in _dynamoPaths:
        settingsFile = IO.Path.Combine(_appdata, path, _settingsFilename)
        if IO.File.Exists(settingsFile):
            with open(settingsFile, 'rb') as outf:
                for line in outf:
                    if line.strip().startswith('<CustomPackageFolders>'):
                        for l in outf:
                            if l.strip().startswith('</CustomPackageFolders>'):
                                break
                            else:
                                pkf.append(l.replace('</string>', '').replace('<string>', '').strip())

    for p in pkf:
        pp = IO.Path.Combine(p, 'packages', plugin, 'extra')
        # In case of custom folders user may put honeybee under the root folder
        ppp = IO.Path.Combine(p, plugin, 'extra')
        if IO.Directory.Exists(pp):
            return pp
        elif IO.Directory.Exists(ppp):
            return ppp


try:
    plugin, filename = IN

    p = tryGetPluginPath(plugin)

    if not p:
        raise ImportError('{} is not installed! Install it from package manager.'.format(plugin))

	# import the file and wrap it into sys.append
    f = IO.Path.Combine(p, 'nodesrc', filename)
    with open(f, 'rb') as inf:
        source = '    '.join(inf.readlines())

    header = 'try:\n    import sys\n' + \
        '    sys.path.append(r\'{}\')\n\n'.format(p) + \
        '    sys.path.append(r\'C:\Program Files (x86)\IronPython 2.7\Lib\')\n\n' + \
        '    '

    footer = '\nexcept Exception, e:\n' + \
        '    import traceback\n' + \
        '    OUT = "ERROR:\\n\\t{}".format(str(e)) + \\\n' + \
        '    "\\n\\nIf you think this is a bug submit an issue on github.\\n" + \\\n' + \
        '    "https://github.com/ladybug-tools/honeybee-dynamo/issues\\n" +  \\\n' + \
        '    "and include below error message:\\n\\n" + \\\n' + \
        '    "{}".format(traceback.format_exc())\n'

    OUT = header + source + footer

except Exception, e:
    import sys
    sys.path.append(r'C:\Program Files (x86)\IronPython 2.7\Lib')
    import traceback
    OUT = "ERROR:\n\t{}".format(str(e)) + \
        "\n\nIf you think this is a bug submit an issue on github.\n" + \
        "https://github.com/ladybug-tools/honeybee-dynamo/issues\n" +  \
        "and include below error message:\n\n" + \
        "{}".format(traceback.format_exc())

      
# ----------------------------------------
epwFile = Input(_epwFile: string)  # An .epw file path on your system as a string.
core = PythonStringNode(script=import_and_prepare_py_code, IN[0]=epwFile)
decompose_outputs = CodeBlock(out=core)
# ---------- decompose_outputs.designscript (17 lines) ----------
out[0];
out[1];
out[2];
out[3];
out[4];
out[5];
out[6];
out[7];
out[8];
out[9];
out[10];
out[11];
out[12];
out[13];
out[14];
out[15];
out[16];
# ----------------------------------------
Output = Output(decompose_outputs.out0)  # ...
location = Output(decompose_outputs.out1)  # A list of text summarizing the location data in the weather file (use this to construct the sun path).
dryBulbTemperature = Output(decompose_outputs.out2)  # "This is the houlry dry bulb temperature, in C. Note that this is a full numeric field (i.e. 23.6) and not an integer representation with tenths. Valid values range from 70 C to 70 C. Missing value for this field is 99.9."
dewPointTemperature = Output(decompose_outputs.out3)  # "This is the hourly dew point temperature, in C. Note that this is a full numeric field (i.e. 23.6) and not an integer representation with tenths. Valid values range from 70 C to 70 C. Missing value for this field is 99.9."
relativeHumidity = Output(decompose_outputs.out4)  # "This is the hourly Relative Humidity in percent. Valid values range from 0% to 110%. Missing value for this field is 999."
windSpeed = Output(decompose_outputs.out5)  # "This is the hourly wind speed in m/sec. Values can range from 0 to 40. Missing value is 999."
windDirection = Output(decompose_outputs.out6)  # "This is the hourly Wind Direction in degrees where the convention is that North=0.0, East=90.0, South=180.0, West=270.0. (If wind is calm for the given hour, the direction equals zero.) Values can range from 0 to 360. Missing value is 999."
directNormalRadiation = Output(decompose_outputs.out7)  # "This is the hourly Direct Normal Radiation in Wh/m2. (Amount of solar radiation in Wh/m2 received directly from the solar disk on a surface perpendicular to the sun's rays, during the number of minutes preceding the time indicated.) If the field is missing ( 9999) or invalid (<0), it is set to 0. Counts of such missing values are totaled and presented at the end of the runperiod."
diffuseHorizontalRadiation = Output(decompose_outputs.out8)  # "This is the hourly Diffuse Horizontal Radiation in Wh/m2. (Amount of solar radiation in Wh/m2 received from the sky (excluding the solar disk) on a horizontal surface during the number of minutes preceding the time indicated.) If the field is missing ( 9999) or invalid (<0), it is set to 0. Counts of such missing values are totaled and presented at the end of the runperiod."
globalHorizontalRadiation = Output(decompose_outputs.out9)  # "This is the hourly Global Horizontal Radiation in Wh/m2. (Total amount of direct and diffuse solar radiation in Wh/m2 received on a horizontal surface during the number of minutes preceding the time indicated.) It is not currently used in EnergyPlus calculations. It should have a minimum value of 0; missing value for this field is 9999."
directNormalIlluminance = Output(decompose_outputs.out10)  # "This is the hourly Direct Normal Illuminance in lux. (Average amount of illuminance in hundreds of lux received directly from the solar disk on a surface perpendicular to the sun's rays, during the number of minutes preceding the time indicated.) It is not currently used in EnergyPlus calculations. It should have a minimum value of 0; missing value for this field is 999999 and will be considered missing of >= 999900."
diffuseHorizontalIlluminance = Output(decompose_outputs.out11)  # "This is the hourly Diffuse Horizontal Illuminance in lux. (Average amount of illuminance in hundreds of lux received from the sky (excluding the solar disk) on a horizontal surface during the number of minutes preceding the time indicated.) It is not currently used in EnergyPlus calculations. It should have a minimum value of 0; missing value for this field is 999999 and will be considered missing of >= 999900."
globalHorizontalIlluminance = Output(decompose_outputs.out12)  # "This is the hourly Global Horizontal Illuminance in lux. (Average total amount of direct and diffuse illuminance in hundreds of lux received on a horizontal surface during the number of minutes preceding the time indicated.) It is not currently used in EnergyPlus calculations. It should have a minimum value of 0; missing value for this field is 999999 and will be considered missing of >= 999900."
totalSkyCover = Output(decompose_outputs.out13)  # "This is the fraction for total sky cover (tenths of coverage). (i.e. 1 is 1/10 covered. 10 is total coverage). (Amount of sky dome in tenths covered by clouds or obscuring phenomena at the hour indicated at the time indicated.) Minimum value is 0; maximum value is 10; missing value is 99."
liquidPrecipitationDepth = Output(decompose_outputs.out14)  # "The amount of liquid precipitation(mm) observed at the indicated hour for the period indicated in the liquid precipitation quantity field. If this value is not missing, then it is used and overrides the precipitation flag as rainfall.  Conversely, if the precipitation flag shows rain and this field is missing or zero, it is set to 1.5 (mm)."
barometricPressure = Output(decompose_outputs.out15)  # "This is the hourly weather station pressure in Pa. Valid values range from 31,000 to 120,000... Missing value for this field is 999999."
modelYear = Output(decompose_outputs.out16)  # The year from which the hourly data has been extracted. EPW files are synthesized from real recorded data from different years in a given climate. This is done to ensure that, for each month, the selected data is statistically representative of the average monthly conditions over the 18+ years of recording the data. Different EPW files will be synthesized from different years depeding on whether they are TMY (Typical Meteorological Year), TMY2, TMY3, AMY (Actual Meteorological Year) or other.
error_report = Python(IN[0]=import_and_prepare_py_code, IN[1]=core)
# ---------- error_report.python (17 lines) ----------
        
"""Report errors"""
importErr, runErr = IN
errors = []

if importErr and str(importErr).startswith("ERROR:"):
    errors.append(importErr)

if runErr and str(runErr).startswith("ERROR:"):
    errors.append(runErr)

if len(errors)==0:
    OUT = "All good! Vvizzzz."
else:
    OUT = "\n".join(errors)

      
# ----------------------------------------
ERRReport = Output(error_report)  # Report
