# Dynamo custom node Sunpath.dyf "SunPath" (Dynamo 1.2.0.2690)
# category: Ladybug.02 :: VisualizeWeatherData
# Use this component to make a 3D sun-path (aka. sun plot). The component also outputs sun vectors that can be used for solar access analysis or shading design. -

input_python_script = CodeBlock { "Ladybug"; "sunpath_node.py"; }
import_and_prepare_py_code = Python(IN[0]=input_python_script.out0, IN[1]=input_python_script.out1)
# ---------- import_and_prepare_py_code.python (88 lines) ----------
        
"""Find packages from Dynamo folder and prepare the code."""
import clr
from System import AppDomain, Environment, IO

def tryGetPluginPath(plugin):
    """Try to get path to plugin folder."""
    clr.AddReference('ProtoGeometry')
    _loc = tuple(a.Location
                 for a in AppDomain.CurrentDomain.GetAssemblies()
                 if 'ProtoGeometry' in a.FullName)

    try:
        _ver = float(_loc[0].split('\\')[-2])
    except:
        _ver = float(_loc[0].split('\\')[-2].split(' ')[-1])

    assert _ver >= 1.2, 'You need Dynamo 1.2 or higher to use this plugin!'

    _appdata = Environment.GetFolderPath(Environment.SpecialFolder.ApplicationData)
    _dynamoPath = '%s\\%.1f' % (('\\').join(_loc[0].split('\\')[-4:-2]), float(_loc[0].split('\\')[-2]))
    # if the assembly is cached put Revit folder first, and then try to load it from core
    _dynamoPaths = (_dynamoPath.replace('Dynamo Core', 'Dynamo Revit'),
                    _dynamoPath.replace('Dynamo Revit', 'Dynamo Core'))
    _settingsFilename = 'DynamoSettings.xml'

    pkf = []
    for path in _dynamoPaths:
        settingsFile = IO.Path.Combine(_appdata, path, _settingsFilename)
        if IO.File.Exists(settingsFile):
            with open(settingsFile, 'rb') as outf:
                for line in outf:
                    if line.strip().startswith('<CustomPackageFolders>'):
                        for l in outf:
                            if l.strip().startswith('</CustomPackageFolders>'):
                                break
                            else:
                                pkf.append(l.replace('</string>', '').replace('<string>', '').strip())

    for p in pkf:
        pp = IO.Path.Combine(p, 'packages', plugin, 'extra')
        # In case of custom folders user may put honeybee under the root folder
        ppp = IO.Path.Combine(p, plugin, 'extra')
        if IO.Directory.Exists(pp):
            return pp
        elif IO.Directory.Exists(ppp):
            return ppp


try:
    plugin, filename = IN

    p = tryGetPluginPath(plugin)

    if not p:
        raise ImportError('{} is not installed! Install it from package manager.'.format(plugin))

	# import the file and wrap it into sys.append
    f = IO.Path.Combine(p, 'nodesrc', filename)
    with open(f, 'rb') as inf:
        source = '    '.join(inf.readlines())

    header = 'try:\n    import sys\n' + \
        '    sys.path.append(r\'{}\')\n\n'.format(p) + \
        '    sys.path.append(r\'C:\Program Files (x86)\IronPython 2.7\Lib\')\n\n' + \
        '    '

    footer = '\nexcept Exception, e:\n' + \
        '    import traceback\n' + \
        '    OUT = "ERROR:\\n\\t{}".format(str(e)) + \\\n' + \
        '    "\\n\\nIf you think this is a bug submit an issue on github.\\n" + \\\n' + \
        '    "https://github.com/ladybug-tools/ladybug-dynamo/issues\\n" +  \\\n' + \
        '    "and include below error message:\\n\\n" + \\\n' + \
        '    "{}".format(traceback.format_exc())\n'

    OUT = header + source + footer

except Exception, e:
    import sys
    sys.path.append(r'C:\Program Files (x86)\IronPython 2.7\Lib')
    import traceback
    OUT = "ERROR:\n\t{}".format(str(e)) + \
        "\n\nIf you think this is a bug submit an issue on github.\n" + \
        "https://github.com/ladybug-tools/ladybug-dynamo/issues\n" +  \
        "and include below error message:\n\n" + \
        "{}".format(traceback.format_exc())

      
# ----------------------------------------
north = Input(north_: double = 0)  # Input a number between 0 and 360. It represents the degrees off from the y-axis to make North. The default North direction is set to the Y-axis (0 degrees).
location = Input(_location: var)  # The output from the importEPW or constructLocation component. This is essentially a list of text summarizing a location on the earth.
hoys = Input(_hoys_: double[] = {})  # A list or a single number that respresent an hour of the year. Use Analysis Period or HOY nodes to generate the numbers.
centerPt = Input(_centerPt_: Autodesk.Point = Autodesk.Point.ByCoordinates(0,0,0))  # Input a point here to change the location of the sun path. The default is set to the Dynamo model origin (0,0,0).
scale = Input(_scale_: double = 1)  # Input a number here to change the scale of the sun path. The default is set to 1.
sunScale = Input(_sunScale_: double = 1)  # Input a number here to change the scale of the sun spheres located along the sun path.  The default is set to 1.
annual = Input(_annual_: bool = true)  # By default, this value is set to "True" (or 1) which will produce a sun path for the whole year. Set this input to "False" (or 0) to generate a sun path for just one day of the year (or several days if multiple days are included in the analysis period).
core = PythonStringNode(script=import_and_prepare_py_code, IN[0]=north, IN[1]=location, IN[2]=hoys, IN[3]=centerPt, IN[4]=scale, IN[5]=sunScale, IN[6]=annual)
decompose_outputs = CodeBlock(out=core) { out[0]; out[1]; out[2]; out[3]; out[4]; out[5]; out[6]; out[7]; out[8]; out[9]; }
vectors = Output(decompose_outputs.out0)  # Vector(s) indicating the direction of sunlight for each sun position on the sun path.
altitudes = Output(decompose_outputs.out1)  # Number(s) indicating the sun altitude(s) in degrees for each sun position on the sun path.
azimuths = Output(decompose_outputs.out2)  # Number(s) indicating the sun azimuths in degrees for each sun position on the sun path.
sunPts = Output(decompose_outputs.out3)  # Point(s) idicating the location on the sun path of each sun position.
analemma = Output(decompose_outputs.out4)  # A set of curves that mark the path of the sun across the sky dome.
compass = Output(decompose_outputs.out5)  # Script variable sunpath
daily = Output(decompose_outputs.out6)  # Script variable sunpath
centerPt_2 = Output(decompose_outputs.out7)  # "centerPt"; The center point of the sun path
hoys_2 = Output(decompose_outputs.out8)  # "hoys"; The hour of the year for each sun position on the sun path.
datetimes = Output(decompose_outputs.out9)  # The date and info for each sun position on the sun path.
error_report = Python(IN[0]=import_and_prepare_py_code, IN[1]=core)
# ---------- error_report.python (17 lines) ----------
        
"""Report errors"""
importErr, runErr = IN
errors = []

if importErr and str(importErr).startswith("ERROR:"):
    errors.append(importErr)

if runErr and str(runErr).startswith("ERROR:"):
    errors.append(runErr)

if len(errors)==0:
    OUT = "All good! Vvizzzz."
else:
    OUT = "\n".join(errors)

      
# ----------------------------------------
ERRReport = Output(error_report)  # Report
