# Dynamo custom node Sunpath.dyf (Dynamo 1.2.0.2690)
# category: Ladybug.2 :: Visualize Weather Data
# Use this node to make a 3D sun-path (aka. sun plot) in the Dynamo scene.  The node also outputs sun vectors that can be used for sunlight hours analysis or shading design with the other Ladybug nodes.

# group: load the script
code_block = CodeBlock { "Ladybug"; "sunpath_node.py"; }

import_and_prepare_py_code = Python(IN[0]=code_block.out0, IN[1]=code_block.out1)
# ---------- import_and_prepare_py_code.python (78 lines) ----------
"""Find packages from Dynamo folder and prepare the code."""
import clr
from System import AppDomain, Environment, IO

def tryGetPluginPath(plugin):
    """Try to get path to plugin folder."""
    clr.AddReference('ProtoGeometry')
    _loc = tuple(a.Location
                 for a in AppDomain.CurrentDomain.GetAssemblies()
                 if 'ProtoGeometry' in a.FullName)

    try:
        _ver = float(_loc[0].split('\\')[-2])
    except:
        _ver = float(_loc[0].split('\\')[-2].split(' ')[-1])

    assert _ver >= 1.2, 'You need Dynamo 1.2 or higher to use this plugin!'

    _appdata = Environment.GetFolderPath(Environment.SpecialFolder.ApplicationData)
    _dynamoPath = ('\\').join(_loc[0].split('\\')[-4:-1])
    # if the assembly is cached put Revit folder first, and then try to load it from core
    _dynamoPaths = (_dynamoPath.replace('Dynamo Core', 'Dynamo Revit'),
                    _dynamoPath.replace('Dynamo Revit', 'Dynamo Core'))
    _settingsFilename = 'DynamoSettings.xml'
    
    pkf = []
    for path in _dynamoPaths:
        settingsFile = IO.Path.Combine(_appdata, path, _settingsFilename)
        if not IO.File.Exists(settingsFile):
        	continue
        with open(settingsFile, 'rb') as outf:
            for line in outf:
                if line.strip().startswith('<CustomPackageFolders>'):
                    for l in outf:
                        if l.strip().startswith('</CustomPackageFolders>'):
                            break
                        else:
                            pkf.append(l.replace('</string>', '').replace('<string>', '').strip())

    for p in pkf:
        pp = IO.Path.Combine(p, 'packages', plugin, 'extra')
        if IO.Directory.Exists(pp):
            return pp

try:
    plugin, filename = IN
    p = tryGetPluginPath(plugin)
    if not p:
        raise ImportError('{} is not installed! Install it from package manager.'.format(plugin))
    # import the file and wrap it into sys.append
    f = IO.Path.Combine(p, 'nodesrc', filename)
    with open(f, 'rb') as inf:
        source = '    '.join(inf.readlines())

    header = 'try:\n    import sys\n' + \
        '    sys.path.append(r\'{}\')\n\n'.format(p) + \
        '    sys.path.append(r\'C:\Program Files (x86)\IronPython 2.7\Lib\')\n\n' + \
        '    '

    footer = '\nexcept Exception, e:\n' + \
        '    import traceback\n' + \
        '    OUT = "ERROR:\\n\\t{}".format(str(e)) + \\\n' + \
        '    "\\n\\nIf you think this is a bug submit an issue on github.\\n" + \\\n' + \
        '    "https://github.com/ladybug-analysis-tools/honeybee-plus/issues\\n" +  \\\n' + \
        '    "and include below error message:\\n\\n" + \\\n' + \
        '    "{}".format(traceback.format_exc())\n'

    OUT = header + source + footer

except Exception, e:
    import sys
    sys.path.append(r'C:\Program Files (x86)\IronPython 2.7\Lib')
    import traceback
    OUT = "ERROR:\n\t{}".format(str(e)) + \
        "\n\nIf you think this is a bug submit an issue on github.\n" + \
        "https://github.com/ladybug-analysis-tools/honeybee-plus/issues\n" +  \
        "and include below error message:\n\n" + \
        "{}".format(traceback.format_exc())
# ----------------------------------------
Input_a_number_between_0_and_360_It_repr = Input(/* Input a number between 0 and 360 It represents the degrees off from the y-axis to make North. The default North direction is set to the Y-axis (0 degrees). */ north_: double = 0)
The_output_from_the_importEPW_or_constru = Input(/* The output from the importEPW or constructLocation component. This is essentially a list of text summarizing a location on the earth. */ _location: var)
A_list_or_a_single_number_that_respresen = Input(/* A list or a single number that respresent an hour of the year. Use Analysis Period or HOY nodes to generate the numbers. */ _hoursOfYear_: var[]..[] = {12})
Input_a_point_here_to_change_the_locatio = Input(/* Input a point here to change the location of the sun path. The default is set to the Dynamo model origin (0,0,0). */ _centerPt_: Autodesk.Geometry.Point = Autodesk.Geometry.Point.Origin())
Input_a_number_here_to_change_the_scale_ = Input(/* Input a number here to change the scale of the sun path. The default is set to 1. */ _scale_: double = 1)
sunScale = Input(_sunScale_: double = 1)  # Input a number here to change the scale of the sun spheres located along the sun path.  The default is set to 1.
annualSunpath = Input(_annualSunpath_: bool = true)  # By default, this value is set to "True" (or 1) which will produce a sun path for the whole year. Set this input to "False" (or 0) to generate a sun path for just one day of the year (or several days if multiple days are included in the analysis period).
python_script_from_string = PythonStringNode(script=import_and_prepare_py_code, IN[0]=Input_a_number_between_0_and_360_It_repr, IN[1]=The_output_from_the_importEPW_or_constru, IN[2]=A_list_or_a_single_number_that_respresen, IN[3]=Input_a_point_here_to_change_the_locatio, IN[4]=Input_a_number_here_to_change_the_scale_, IN[5]=sunScale, IN[6]=annualSunpath)
code_block_2 = CodeBlock(out=python_script_from_string) { out[0]; out[1]; out[2]; out[3]; out[4]; out[5]; out[6]; out[7]; }
sunVectors = Output(code_block_2.out0)  # List of sun vectors
sunAltitudes = Output(code_block_2.out1)  # List of sun altitudes
sunAzimuths = Output(code_block_2.out2)  # List of sun azimuths
sunSpheres = Output(code_block_2.out3)  # List of sun geometries as spheres
geometry = Output(code_block_2.out4)  # Sun path geometry
centerPt = Output(code_block_2.out5)  # Sun path center-point
sunPositions = Output(code_block_2.out6)  # Sun positions as a list of Points
datetimes = Output(code_block_2.out7)  # List of date and time info for each sun position
error_report = Python(IN[0]=import_and_prepare_py_code, IN[1]=python_script_from_string)
# ---------- error_report.python (15 lines) ----------
"""Report errors"""
importErr = IN[0]
runErr = IN[1]
errors = []

if importErr and str(importErr).startswith("ERROR:"):
	errors.append(importErr)

if runErr and str(runErr).startswith("ERROR:"):
	errors.append(runErr)

if len(errors)==0:
	OUT = "All good! Vvizzzz."
else:
	OUT = "\n".join(errors)
# ----------------------------------------
ERRReport = Output(error_report)  # Report
