# Dynamo graph 04_gencumulativeSky.dyn (Dynamo 1.0.0.193)

file_path = Filename("C:\EnergyPlusV8-3-0\WeatherData\USA_CO_Golden-NREL.724666_TMY3.epw")

# group: Generate sky matrix for running radiation analysis. If you are running thie file in Dynamo Studio the run will fail at the first run for each weather file - Give it a couple of seconds and re-connect the weather file address and re-run the file and you'll get the results as expected! PSThere is a technical reason for this wich will be fixed for the next release.
# note: Generating sky can take up to few minutes.
# If you're testing the file in DynamoStudio it will fail for the first run but will load the results on the second run!
generate_sky_matrix = Custom[Generate Sky Matrix](epwFile=file_path)  # Generate sky matrix for a location from epw file

watch = Watch(generate_sky_matrix)

# group: Filter sky matrix for Radiation Analysis. In the next release you can use the sky matrix to draw sky dome and radiation rose.
filter_sky_matrix = Custom[Filter Sky Matrix](skyMatrix=generate_sky_matrix)  # Filter Cumulative Sky for an analysis period. You can also filter diffuse or direct component of the sky

watch_2 = Watch(filter_sky_matrix.skyRadiationValues)
watch_3 = Watch(filter_sky_matrix.filteredSkyMatrix)
