# Dynamo graph 00_importEpw.dyn (Dynamo 0.9.1.3872)

# group: Select an epw weather file. If you don't have any epw files you can download one from epwmap: http://mostapharoudsari.github.io/epwmap/
file_path = Filename("C:\EnergyPlusV8-3-0\WeatherData\USA_FL_Tampa.Intl.AP.722110_TMY3.epw")

import_epw = Custom[Import epw](epwFile=file_path)  # Use this node to import lists of weather data into Dynamo from a standard .epw file. For detailed information about the structure of an epw file, you may want to read the "Weather Converter Program" section in "Auxiliary EnergyPlus Programs" document. All descriptions of importaed data are borrowed from this document. The document is available online at this address: "http://apps1.eere.energy.gov/buildings/energyplus/pdfs/auxiliaryprograms.pdf"
watch = Watch(import_epw.dryBulbTemperature)
analysis_period = Custom[Analysis Period]()  # Create a Ladybug Analysis Period
watch_2 = Watch(analysis_period.dates)
watch_3 = Watch(analysis_period.hoursOfYear)
watch_4 = Watch(analysis_period.analysisPeriod)
import_location = Custom[Import Location](epwFile=file_path)  # Import location data from an epw weather file
deconstruct_location = Custom[Deconstruct Location](location=import_location.location)  # Get different location data from a location string
construct_location = Custom[Construct Location](locationName=deconstruct_location.locationName, latitude=deconstruct_location.latitude, longitude=deconstruct_location.longitude, timeZone=deconstruct_location.timeZone, elevation=deconstruct_location.elevation)  # Construct a Ladybug location based on input data
watch_5 = Watch(construct_location.location)
