# Dynamo graph 01_sunpath.dyn (Dynamo 0.9.1.3872)

north_angle_from_yaxis = CodeBlock { 0; }
file_path = Filename("C:\EnergyPlusV8-3-0\WeatherData\USA_VA_Sterling-Washington.Dulles.Intl.AP.724030_TMY3.epw")
import_location = Custom[Import Location](epwFile=file_path)  # Import location data from an epw weather file
month = DoubleSlider(6, range=1..12 step 1)
code_block = CodeBlock { 6..20; }
calculate_hoy = Custom[Calculate HOY](month=month, hour=code_block)  # Calculate hour of year for a month, day and hour
boolean = BoolSelector(true)

# group: Sunpath In some cases sunpath gives an error not being able to create spheres. Usually re-running the node solves the issue. You need to make a change in inputs so Dynamo pick the component as changed! This will be fixed by the next release.
sunpath = Custom[Sunpath](north=north_angle_from_yaxis, location=import_location.location, hoursOfYear=calculate_hoy.HOY, annualSunpath=boolean)  # Use this node to make a 3D sun-path (aka. sun plot) in the Dynamo scene. The node also outputs sun vectors that can be used for sunlight hours analysis or shading design with the other Ladybug nodes.

byStartPointEndPoint = Line.ByStartPointEndPoint(startPoint=sunpath.centerPt, endPoint=sunpath.sunPositions)
change_the_scale = CodeBlock { 0.5; }
HOY = DoubleSlider(8, range=1..24 step 1)
watch = Watch(sunpath.ERRReport)
