# Dynamo graph 02_genTestPts.dyn (Dynamo 0.9.1.3872)

XZ = Plane.XZ()
code_block = CodeBlock { 10; }
byWidthLength = Rectangle.ByWidthLength(plane=XZ, width=code_block, length=code_block)
byPatch = Surface.ByPatch(byWidthLength)
center_point = CodeBlock(s=byPatch) { s.PointAtParameter(0.5,0.5); }

# group: Just for better visualization
code_block_2 = CodeBlock { 0.2; }
byCenterPointRadius = Sphere.ByCenterPointRadius(centerPoint=center_point, radius=code_block_2)

code_block_3 = CodeBlock { 0; }

# group: Ladybug color range Check _index_ description for more information.
lb_color_range = Custom[LB Color Range](index=code_block_3)  # A set of color ranges for coloring analysis results

# group: Legend Parameters
legend_parameters = Custom[Legend Parameters](colors=lb_color_range.colors)  # Use legend parameter to set up results visualization setting

domain = CodeBlock { {"min",5}; }
XY = Plane.XY()
code_block_4 = CodeBlock { 20; }
code_block_5 = CodeBlock { 10; }
byWidthLength_2 = Rectangle.ByWidthLength(plane=XY, width=code_block_4, length=code_block_5)
byPatch_2 = Surface.ByPatch(byWidthLength_2)
create = List.Create(byPatch_2, byPatch)
code_block_6 = CodeBlock { 20; }

# group: Use Ladybug's generate test point to generate test points. In this example we use this test points to color the surface based on distance from test points.
generate_test_points = Custom[Generate Test Points](testSurfaces=create, numOfSegments=code_block_6)  # Generate test points from a surface based on number of segments and distance from the surface

distanceTo = Geometry.DistanceTo(geometry=generate_test_points.testPts, other=center_point)
# note: Here is an example for segmented coloring
domain_2 = CodeBlock { 1; }
code_block_7 = CodeBlock { {0, 2, 4, 8}; }
code_block_8 = CodeBlock { 2; }

# group: Ladybug color range Check _index_ description for more information.
lb_color_range_2 = Custom[LB Color Range](index=code_block_8)

code_block_9 = CodeBlock { {0,2,4,6,8}; }
getItemAtIndex = List.GetItemAtIndex(list=lb_color_range_2.colors, index=code_block_9)

# group: Legend Parameters
legend_parameters_2 = Custom[Legend Parameters](cType=domain_2, domain=code_block_7, colors=getItemAtIndex)

color_surface = Custom[Color Surface](analysisSurfaces=create, values=distanceTo, legendPar=legend_parameters_2.legendPar)  # Color a test surface based on the results of a study. The results structure should match the test points structure to be mapped correctly on the surface.
