# Dynamo graph 04_gencumulativeSky.dyn (Dynamo 0.9.1.3872)

file_path = Filename("C:\EnergyPlusV8-1-0\WeatherData\USA_IL_Chicago-OHare.Intl.AP.725300_TMY3.epw")

# group: Generate sky matrix for running radiation analysis. If you are running thie file in Dynamo Studio the run will fail at the first run for each weather file - Give it a couple of seconds and re-connect the weather file address and re-run the file and you'll get the results as expected! PSThere is a technical reason for this wich will be fixed for the next release.
# note: Generating sky can take up to few minutes.
generate_sky_matrix = Custom[Generate Sky Matrix](epwFile=file_path)  # Generate sky matrix for a location from epw file

watch = Watch(generate_sky_matrix.ERRReport)

# group: Filter sky matrix for Radiation Analysis. In the next release you can use the sky matrix to draw sky dome and radiation rose.
filter_sky_matrix = Custom[Filter Sky Matrix](skyMatrix=generate_sky_matrix.SkyMatrix)  # Filter Cumulative Sky for an analysis period. You can also filter diffuse or direct component of the sky

watch_2 = Watch(filter_sky_matrix.skyRadiationValues)
watch_3 = Watch(filter_sky_matrix.filteredSkyMatrix)
