# Dynamo graph 05_radiationAnalysis.dyn (Dynamo 0.9.1.3872)

file_path = Filename("C:\EnergyPlusV8-3-0\WeatherData\USA_CO_Golden-NREL.724666_TMY3.epw")

# group: Generate sky matrix for running radiation analysis. If you are running thie file in Dynamo Studio the run will fail at the first run for each weather file - Give it a couple of seconds and re-connect the weather file address and re-run the file and you'll get the results as expected! PSThere is a technical reason for this wich will be fixed for the next release.
generate_sky_matrix = Custom[Generate Sky Matrix](epwFile=file_path)  # Generate sky matrix for a location from epw file

watch = Watch(generate_sky_matrix.ERRReport)

# group: Create test geometries!
XY = Plane.XY()
code_block = CodeBlock { 100; }
byWidthLength = Rectangle.ByWidthLength(plane=XY, width=code_block, length=code_block)
byPatch = Surface.ByPatch(byWidthLength)
byCoordinates = Point.ByCoordinates()
YAxis = Vector.YAxis()
code_block_2 = CodeBlock { 45; }
rotate = Geometry.Rotate(geometry=byWidthLength, origin=byCoordinates, axis=YAxis, degrees=code_block_2)
byPatch_2 = Surface.ByPatch(rotate)
code_block_3 = CodeBlock { 0.5; }
scale = Geometry.Scale(geometry=byPatch_2, xamount=code_block_3, yamount=code_block_3, zamount=code_block_3)

create = List.Create(byPatch, scale)

# group: Generate test points
number_of_segments = CodeBlock { 14; }
distance_from_base = CodeBlock { 0.1; }
generate_test_points = Custom[Generate Test Points](testSurfaces=create, numOfSegments=number_of_segments, disFromSurface=distance_from_base)  # Generate test points from a surface based on number of segments and distance from the surface

code_block_4 = CodeBlock { 6; }
code_block_5 = CodeBlock { 10; }
# note: Generating sky can take up to few minutes.
calculate_hoy = Custom[Calculate HOY](month=code_block_4, hour=code_block_5)  # Calculate hour of year for a month, day and hour

# group: Filter sky matrix for Radiation Analysis. In the next release you can use the sky matrix to draw sky dome and radiation rose.
filter_sky_matrix = Custom[Filter Sky Matrix](skyMatrix=generate_sky_matrix.SkyMatrix, HOYs=calculate_hoy.HOY)  # Filter Cumulative Sky for an analysis period. You can also filter diffuse or direct component of the sky

# group: This node calculates solar radiation for each test point under the attached sky. Radiation analysis can take few minutes depending on number of test points and geometries. The results is in wh for each test point.
solar_radiation_analysis = Custom[Solar Radiation Analysis](testPoints=generate_test_points.testPts, pointsNormal=generate_test_points.ptsNormal, geometries=create, filteredSkyMatrix=filter_sky_matrix.filteredSkyMatrix)  # Calculate solar radiation for points in wh

# group: Color surfaces based on results
color_surface = Custom[Color Surface](analysisSurfaces=create, values=solar_radiation_analysis.solarRadiation)  # Color a test surface based on the results of a study. The results structure should match the test points structure to be mapped correctly on the surface.

watch_2 = Watch(solar_radiation_analysis.solarRadiation)
