# Dynamo graph 02_genTestPts.dyn (Dynamo 1.3.0.875)

XZ = Plane.XZ()
code_block = CodeBlock { 10; }
byWidthLength = Rectangle.ByWidthLength(plane=XZ, width=code_block, length=code_block)
byPatch = Surface.ByPatch(byWidthLength)
center_point = CodeBlock(s=byPatch) { s.PointAtParameter(0.5,0.5); }

# group: Just for better visualization
code_block_2 = CodeBlock { 0.2; }
byCenterPointRadius = Sphere.ByCenterPointRadius(centerPoint=center_point, radius=code_block_2)

# note: Here is an example for segmented coloring
code_block_3 = CodeBlock { {0, 2, 4, 8}; }
code_block_4 = CodeBlock { 2; }

# group: Ladybug color range Check _index_ description for more information.
color_range = Custom[Color Range](index=code_block_4)  # Use this component to access a library of typical gradients useful throughout Ladybug. The output from this component should be plugged into the colors_ input of the "Legend Parameters" component. For an image of each of the gardients in the library, check here: https://github.com/mostaphaRoudsari/ladybug/blob/master/resources/gradients.jpg -

code_block_5 = CodeBlock { {0,2,4,6,8}; }
getItemAtIndex = List.GetItemAtIndex(list=color_range.colors, index=code_block_5)

# group: Legend Parameters
legend_parameters = Custom[Legend Parameters](domain=code_block_3, colors=getItemAtIndex)  # Use legend parameter to set up results visualization setting

XY = Plane.XY()
code_block_6 = CodeBlock { 20; }
code_block_7 = CodeBlock { 10; }
byWidthLength_2 = Rectangle.ByWidthLength(plane=XY, width=code_block_6, length=code_block_7)
byPatch_2 = Surface.ByPatch(byWidthLength_2)
create = List.Create(byPatch_2, byPatch)
code_block_8 = CodeBlock { 1; }
create_2 = List.Create(byWidthLength_2, byWidthLength)
generate_test_points_by_grid = Custom[Generate Test Points by Grid Size](testSurfaces=create, gridSize=code_block_8, borders=create_2)  # Generate test points from Dynamo surfaces based on grid size.
byPatch_3 = Surface.ByPatch(generate_test_points_by_grid.polygons)
distanceTo = Geometry.DistanceTo(geometry=generate_test_points_by_grid.testPts, other=center_point)
domain = CodeBlock { {0, 5}; }
code_block_9 = CodeBlock { 0; }

# group: Ladybug color range Check _index_ description for more information.
color_range_2 = Custom[Color Range](index=code_block_9)

# group: Legend Parameters
legend_parameters_2 = Custom[Legend Parameters](domain=domain, colors=color_range_2.colors)

generate_colors = Custom[Generate Colors](values=distanceTo, legendPar=legend_parameters_2.legendPar)  # Use this component to generate colors based on values and legend parameters. -
byGeometryColor = Display.Display.ByGeometryColor(byPatch_3, generate_colors.colors)
