# Dynamo graph 03_sunlighthoursAnalysis.dyn (Dynamo 1.2.0.2690)

code_block = CodeBlock { 1; }

# group: Create test geometries!
XY = Plane.XY()
code_block_2 = CodeBlock { 100; }
byWidthLength = Rectangle.ByWidthLength(plane=XY, width=code_block_2, length=code_block_2)
byPatch = Surface.ByPatch(byWidthLength)
byCoordinates = Point.ByCoordinates()
YAxis = Vector.YAxis()
code_block_3 = CodeBlock { 45; }
rotate = Geometry.Rotate(geometry=byWidthLength, origin=byCoordinates, axis=YAxis, degrees=code_block_3)
byPatch_2 = Surface.ByPatch(rotate)
code_block_4 = CodeBlock { 0.5; }
scale = Geometry.Scale(geometry=byPatch_2, xamount=code_block_4, yamount=code_block_4, zamount=code_block_4)

create = List.Create(byPatch, scale)

# group: Generate test points! In case you don't see the test points re-run the node.
number_of_segments = CodeBlock { 14; }
distance_from_base = CodeBlock { 0.1; }
generate_test_points = Custom[Generate Test Points](testSurfaces=create, numOfSegments=number_of_segments, disFromSurface=distance_from_base)  # Generate test points from a surface based on number of segments and distance from the surface

watch = Watch(generate_test_points.testPts)
file_path = Filename("C:\EnergyPlusV8-3-0\WeatherData\USA_CA_San.Francisco.Intl.AP.724940_TMY3.epw")

# group: Import location data from epw file
import_location = Custom[Import Location](epwFile=file_path)  # Import location data from an epw weather file

code_block_5 = CodeBlock { 6; }
code_block_6 = CodeBlock { 7..20; }

# group: Calculate hours of the year for sunpath
calculate_hoy = Custom[Calculate HOY](month=code_block_5, hour=code_block_6)  # Calculate hour of year for a month, day and hour

# group: Calculate sunpath and sun vectors
sunpath = Custom[Sunpath](location=import_location.location, hoursOfYear=calculate_hoy.HOY)  # Use this node to make a 3D sun-path (aka. sun plot) in the Dynamo scene. The node also outputs sun vectors that can be used for sunlight hours analysis or shading design with the other Ladybug nodes.

watch_2 = Watch(sunpath.sunVectors)
watch_3 = Watch(sunpath.ERRReport)

# group: Calculate Sunlight hours
sunlighthours_analysis = Custom[Sunlighthours Analysis](testPoints=generate_test_points.testPts, geometries=create, sunVectors=sunpath.sunVectors)  # Calculate sunlight hours for a list of test points

# group: Create legend parameters
code_block_7 = CodeBlock { 6; }
lb_color_range = Custom[LB Color Range](index=code_block_7)  # A set of color ranges for coloring analysis results
legend_parameters = Custom[Legend Parameters](colors=lb_color_range.colors)  # Use legend parameter to set up results visualization setting

# group: Color surfaces based on results
generate_colors = Custom[Generate Colors](values=sunlighthours_analysis.sunlightHours, legendPar=legend_parameters.legendPar)  # Color a test surface based on the results of a study. The results structure should match the test points structure to be mapped correctly on the surface.

bySurfaceColors = Display.Display.BySurfaceColors(create, generate_colors.colors)
watch_4 = Watch(generate_colors.ERRReport)
