# Dynamo graph 04_gencumulativeSky.dyn (Dynamo 1.2.0.2690)

file_path = Filename("..\..\..\..\..\..\..\..\..\..\..\ladybug\dynamo%20test\USA_CA_San.Francisco.Intl.AP.724940_TMY3.epw")
code_block = CodeBlock { "c:\ladybug\San Francisco"; }

# group: Generate sky matrix for running radiation analysis.
generate_sky_matrix = Custom[Generate Sky Matrix](epwFile=file_path, workingDir=code_block)  # Generate sky matrix for a location from epw file

watch = Watch(generate_sky_matrix.ERRReport)
# note: Generating sky can take up to few minutes.
code_block_2 = CodeBlock { 0..47; }

# group: Filter sky matrix for Radiation Analysis. In the next release you can use the sky matrix to draw sky dome and radiation rose.
filter_sky_matrix = Custom[Filter Sky Matrix](skyMatrix=generate_sky_matrix.SkyMatrix, HOYs=code_block_2)  # Filter Cumulative Sky for an analysis period. You can also filter diffuse or direct component of the sky

watch_2 = Watch(filter_sky_matrix.ERRReport)
watch_3 = Watch(filter_sky_matrix.filteredSkyMatrix)
