# Dynamo graph 05_radiationAnalysis.dyn (Dynamo 1.2.0.2690)

file_path = Filename("C:\EnergyPlusV8-3-0\WeatherData\USA_CO_Golden-NREL.724666_TMY3.epw")
code_block = CodeBlock { "c:\ladybug\dynamoRadiationTest"; }

# group: Generate sky matrix for running radiation analysis.
generate_sky_matrix = Custom[Generate Sky Matrix](epwFile=file_path, workingDir=code_block)  # Generate sky matrix for a location from epw file

watch = Watch(generate_sky_matrix.SkyMatrix)
code_block_2 = CodeBlock { 6; }
code_block_3 = CodeBlock { 10; }
# note: Generating sky can take up to few minutes.
calculate_hoy = Custom[Calculate HOY](month=code_block_2, hour=code_block_3)  # Calculate hour of year for a month, day and hour

# group: Filter sky matrix for Radiation Analysis. In the next release you can use the sky matrix to draw sky dome and radiation rose.
filter_sky_matrix = Custom[Filter Sky Matrix](skyMatrix=generate_sky_matrix.SkyMatrix)  # Filter Cumulative Sky for an analysis period. You can also filter diffuse or direct component of the sky

watch_2 = Watch(filter_sky_matrix.cumulativeRadiationValues)
python_script = Python(IN[0]=generate_sky_matrix.SkyMatrix)
# ---------- python_script.python (2 lines) ----------
#Assign your output to the OUT variable.
OUT = IN[0].skyTotalRadiation
# ----------------------------------------
origin = Point.Origin()
YAxis = Vector.YAxis()
XAxis = Vector.XAxis()
code_block_4 = CodeBlock { 0; }
rotate = Vector.Rotate(YAxis, XAxis, code_block_4)
code_block_5 = CodeBlock { 10; }
translate = Geometry.Translate(geometry=origin, direction=rotate, distance=code_block_5)
byOriginNormal = Plane.ByOriginNormal(origin=translate, normal=rotate)
code_block_6 = CodeBlock { 4; }
byWidthLength = Rectangle.ByWidthLength(plane=byOriginNormal, width=code_block_6, length=code_block_6)
ZAxis = Vector.ZAxis()
code_block_7 = CodeBlock { 0..360..45; }
rotate_2 = Geometry.Rotate(geometry=byWidthLength, origin=origin, axis=ZAxis, degrees=code_block_7)
byPatch = Surface.ByPatch(rotate_2)

# group: Generate test points
number_of_segments = CodeBlock { 2; }
distance_from_base = CodeBlock { 0.05; }
generate_test_points = Custom[Generate Test Points](testSurfaces=byPatch, numOfSegments=number_of_segments, disFromSurface=distance_from_base)  # Generate test points from a surface based on number of segments and distance from the surface

# group: This node calculates solar radiation for each test point under the attached sky. Radiation analysis can take few minutes depending on number of test points and geometries. The results is in wh for each test point.
solar_radiation_analysis = Custom[Solar Radiation Analysis](testPoints=generate_test_points.testPts, pointsNormal=generate_test_points.ptsNormal, geometries=byPatch, filteredSkyMatrix=filter_sky_matrix.filteredSkyMatrix)  # Calculate solar radiation for points in wh

generate_colors = Custom[Generate Colors](values=solar_radiation_analysis.solarRadiation)  # Color a test surface based on the results of a study. The results structure should match the test points structure to be mapped correctly on the surface.

# group: Color surfaces based on results
byGeometryColor = Display.Display.ByGeometryColor(byPatch, generate_colors.colors)
