# Dynamo graph genTestPts.dyn (Dynamo 1.0.0.193)

# group: load the script
code_block = CodeBlock { "genTestPts_node.py"; }
find_file_and_import_it = Python(IN[0]=code_block)
# ---------- find_file_and_import_it.python (16 lines) ----------
def getPackagePath(packageName):
	import sys
	sys.path.append('C:\Program Files (x86)\IronPython 2.7\Lib')
	import os
	import clr
	clr.AddReference('DynamoCore')
	dynamoPath = clr.References[2].Location.split('\\')[2].replace(' ', '\\')
	appdata = os.getenv('APPDATA')
	return '%s\%s\packages\%s\extra\\'%(appdata, dynamoPath, packageName)

filePath = getPackagePath('Ladybug') + IN[0]

with open(filePath, 'rb') as inf:
    lines = inf.readlines()

OUT = ''.join(lines)
# ----------------------------------------

XY = Plane.XY()
code_block_2 = CodeBlock { 20; }
byWidthLength = Rectangle.ByWidthLength(plane=XY, width=code_block_2, length=code_block_2)
byPatch = Surface.ByPatch(byWidthLength)
XZ = Plane.XZ()
code_block_3 = CodeBlock { 10; }
byWidthLength_2 = Rectangle.ByWidthLength(plane=XZ, width=code_block_3, length=code_block_3)
byPatch_2 = Surface.ByPatch(byWidthLength_2)
create = List.Create(byPatch, byPatch_2)
number_of_segments = CodeBlock { 11; }
distance_from_base = CodeBlock { 0.01; }
python_script_from_string = PythonStringNode(script=find_file_and_import_it, IN[0]=create, IN[1]=number_of_segments, IN[2]=distance_from_base)
python_script = Python()
# ---------- python_script.python (3 lines) ----------
#Assign your output to the OUT variable.
OUT = [[0.0] * 11, [0.1] * 11, [0.2] * 11, [0.3] * 11, [0.4] * 11, [0.5] * 11, \
	  [0.6] * 11, [0.7] * 11, [0.8] * 11, [0.9] * 11, [1.0] * 11]
# ----------------------------------------
color_range = ColorRange(arg2=python_script)
create_2 = List.Create(color_range, color_range)
bySurfaceColors = Display.Display.BySurfaceColors(create, create_2)
