# Dynamo graph gencumulativeSky.dyn (Dynamo 1.0.0.123)

# group: load the script
code_block = CodeBlock { "genskymtx.py"; }
find_file_and_import_it = Python(IN[0]=code_block)
# ---------- find_file_and_import_it.python (16 lines) ----------
def getPackagePath(packageName):
	import sys
	sys.path.append('C:\Program Files (x86)\IronPython 2.7\Lib')
	import os
	import clr
	clr.AddReference('DynamoCore')
	dynamoPath = clr.References[2].Location.split('\\')[2].replace(' ', '\\')
	appdata = os.getenv('APPDATA')
	return '%s\%s\packages\%s\extra\\'%(appdata, dynamoPath, packageName)

filePath = getPackagePath('Ladybug') + IN[0]

with open(filePath, 'rb') as inf:
    lines = inf.readlines()

OUT = ''.join(lines)
# ----------------------------------------

file_path = Filename("C:\EnergyPlusV8-3-0\WeatherData\USA_CO_Golden-NREL.724666_TMY3.epw")
code_block_2 = CodeBlock { 0; }
code_block_3 = CodeBlock { "c:\\ladybug"; }
# note: gencumulativesky
python_script_from_string = PythonStringNode(script=find_file_and_import_it, IN[0]=file_path, IN[1]=code_block_2, IN[2]=code_block_3)
code_block_4 = CodeBlock { 1..10; }
# note: Select Sky
python_script = Python(IN[0]=python_script_from_string, IN[1]=code_block_4)
# ---------- python_script.python (9 lines) ----------
cSky = IN[0]
HOYs = IN[1]

cSky.gendaymtx(analysisPeriod = HOYs)

#Assign your output to the OUT variable.
OUT = [cSky.skyTotalRadiation.values(header = True),
        cSky.skyDiffuseRadiation.values(header = True),
        cSky.skyDirectRadiation.values(header = True)]
# ----------------------------------------
