# Dynamo graph radiationAnalysis.dyn (Dynamo 1.0.0.193)

file_path = Filename("C:\EnergyPlusV8-3-0\WeatherData\USA_CO_Golden-NREL.724666_TMY3.epw")

# group: Generate sky matrix for running radiation analysis. If you are running thie file in Dynamo Studio the run will fail at the first run for each weather file - Give it a couple of seconds and re-connect the weather file address and re-run the file and you'll get the results as expected! PSThere is a technical reason for this wich will be fixed for the next release.
# note: Generating sky can take up to few minutes.
generate_sky_matrix = Custom[Generate Sky Matrix](epwFile=file_path)  # Generate sky matrix for a location from epw file

watch = Watch(generate_sky_matrix)

# group: Create test geometries!
XY = Plane.XY()
code_block = CodeBlock { 100; }
byWidthLength = Rectangle.ByWidthLength(plane=XY, width=code_block, length=code_block)
byPatch = Surface.ByPatch(byWidthLength)
byCoordinates = Point.ByCoordinates()
YAxis = Vector.YAxis()
code_block_2 = CodeBlock { 45; }
rotate = Geometry.Rotate(geometry=byWidthLength, origin=byCoordinates, axis=YAxis, degrees=code_block_2)
byPatch_2 = Surface.ByPatch(rotate)
code_block_3 = CodeBlock { 0.5; }
scale = Geometry.Scale(geometry=byPatch_2, xamount=code_block_3, yamount=code_block_3, zamount=code_block_3)

create = List.Create(byPatch, scale)

# group: load the script
code_block_4 = CodeBlock { "solarradiation_node.py"; }
find_file_and_import_it = Python(IN[0]=code_block_4)
# ---------- find_file_and_import_it.python (16 lines) ----------
def getPackagePath(packageName):
	import sys
	sys.path.append('C:\Program Files (x86)\IronPython 2.7\Lib')
	import os
	import clr
	clr.AddReference('DynamoCore')
	dynamoPath = clr.References[2].Location.split('\\')[2].replace(' ', '\\')
	appdata = os.getenv('APPDATA')
	return '%s\%s\packages\%s\extra\\'%(appdata, dynamoPath, packageName)

filePath = getPackagePath('Ladybug') + IN[0]

with open(filePath, 'rb') as inf:
    lines = inf.readlines()

OUT = ''.join(lines)
# ----------------------------------------

# group: Generate test points
number_of_segments = CodeBlock { 14; }
distance_from_base = CodeBlock { 0.1; }
generate_test_points = Custom[Generate Test Points](testSurfaces=create, numOfSegments=number_of_segments, disFromSurface=distance_from_base)  # Generate test points from a surface based on number of segments and distance from the surface

# group: Filter sky matrix for Radiation Analysis. In the next release you can use the sky matrix to draw sky dome and radiation rose.
filter_sky_matrix = Custom[Filter Sky Matrix](skyMatrix=generate_sky_matrix)  # Filter Cumulative Sky for an analysis period. You can also filter diffuse or direct component of the sky

python_script_from_string = PythonStringNode(script=find_file_and_import_it, IN[0]=generate_test_points.testPts, IN[1]=generate_test_points.ptsNormal, IN[2]=create, IN[3]=filter_sky_matrix.filteredSkyMatrix)

# group: Create legend parameters
code_block_5 = CodeBlock { 6; }
lb_color_range = Custom[LB Color Range](index=code_block_5)  # A set of color ranges for coloring analysis results
legend_parameters = Custom[Legend Parameters](colors=lb_color_range)  # Use legend parameter to set up results visualization setting

# group: Color surfaces based on results
color_surface = Custom[Color Surface](analysisSurfaces=create, values=python_script_from_string, legendPar=legend_parameters)  # Color a test surface based on the results of a study. The results structure should match the test points structure to be mapped correctly on the surface.
