# Dynamo graph sunlighthoursAnalysis.dyn (Dynamo 1.0.0.123)

XY = Plane.XY()
code_block = CodeBlock { 100; }
byWidthLength = Rectangle.ByWidthLength(plane=XY, width=code_block, length=code_block)
byPatch = Surface.ByPatch(byWidthLength)
code_block_2 = CodeBlock()
# ---------- code_block_2.designscript (3 lines) ----------
{Color.ByARGB(225,0,0,0),
Color.ByARGB(225,225,225,225)};
{1,0};
# ----------------------------------------

# group: load the script
code_block_3 = CodeBlock { "sunlighthours_node.py"; }
find_file_and_import_it = Python(IN[0]=code_block_3)
# ---------- find_file_and_import_it.python (16 lines) ----------
def getPackagePath(packageName):
	import sys
	sys.path.append('C:\Program Files (x86)\IronPython 2.7\Lib')
	import os
	import clr
	clr.AddReference('DynamoCore')
	dynamoPath = clr.References[2].Location.split('\\')[2].replace(' ', '\\')
	appdata = os.getenv('APPDATA')
	return '%s\%s\packages\%s\extra\\'%(appdata, dynamoPath, packageName)

filePath = getPackagePath('Ladybug') + IN[0]

with open(filePath, 'rb') as inf:
    lines = inf.readlines()

OUT = ''.join(lines)
# ----------------------------------------

file_path = Filename("C:\EnergyPlusV8-3-0\WeatherData\USA_CA_San.Francisco.Intl.AP.724940_TMY3.epw")
import_location = Custom[Import Location](epwFile=file_path)  # Import location data from an epw weather file
code_block_4 = CodeBlock { 6; }
code_block_5 = CodeBlock { 7..20; }
calculate_hoy = Custom[Calculate HOY](month=code_block_4, hour=code_block_5)  # Calculate hour of year for a month, day and hour
sunpath = Custom[Sunpath](location=import_location, hoursOfYear=calculate_hoy.HOY)  # Use this node to make a 3D sun-path (aka. sun plot) in the Dynamo scene. The node also outputs sun vectors that can be used for sunlight hours analysis or shading design with the other Ladybug nodes.
flatten = Flatten()
byCoordinates = Point.ByCoordinates()
YAxis = Vector.YAxis()
code_block_6 = CodeBlock { 45; }
rotate = Geometry.Rotate(geometry=byWidthLength, origin=byCoordinates, axis=YAxis, degrees=code_block_6)
byPatch_2 = Surface.ByPatch(rotate)
code_block_7 = CodeBlock { 0.5; }
scale = Geometry.Scale(geometry=byPatch_2, xamount=code_block_7, yamount=code_block_7, zamount=code_block_7)
create = List.Create(byPatch, scale)
python_script_from_string = PythonStringNode(script=find_file_and_import_it, IN[0]=sunpath.sunVectors, IN[1]=flatten, IN[2]=create)
code_block_8 = CodeBlock { 1; 0; }
remapRange = Math.RemapRange(numbers=python_script_from_string, newMin=code_block_8.out0, newMax=code_block_8.out1)
color_range = ColorRange(code_block_2.out0, code_block_2.out1, remapRange)
number_of_segments = CodeBlock { 20; }
chop = List.Chop(list=color_range, lengths=number_of_segments)
bySurfaceColors = Display.Display.BySurfaceColors(byPatch, chop)

# group: load the script
code_block_9 = CodeBlock { "test_node.py"; }
find_file_and_import_it_2 = Python(IN[0]=code_block_9)  # same code as find_file_and_import_it

distance_from_base = CodeBlock { 0.1; }
python_script_from_string_2 = PythonStringNode(script=find_file_and_import_it_2, IN[0]=byPatch, IN[1]=number_of_segments, IN[2]=distance_from_base)
